# Requirement set ShipRequirements (R2026a)

## 1 [#1] Platform Support
The vessel must provide the shipboard services and resources necessary to support vessel operations.
Rationale: The operator, crew, and owner require the vessel to provide the shipboard services and
resources necessary to conduct vessel operations.

### 1.1 [#2] Electrical Power
The vessel shall provide electrical power necessary to support vessel operations.
Rationale: Electrical power is required to operate propulsion, command and surveillance systems, auxiliary systems, outfitting systems, and mission-specific systems.

#### 1.1.1 [#3] Shipboard Power Generation
The vessel shall generate the electrical power required by the shipboard load schedule for each defined operating condition.
Rationale: Shipboard electrical loads require an onboard source of electrical power when shore-supplied power is unavailable.

#### 1.1.2 [#4] Electrical Power Distribution
The vessel shall distribute electrical power from each available electrical source to each required load identified in the shipboard load schedule.
Rationale: Generated, stored, or shore-supplied electrical power must be transferred to the systems and equipment that require it.

#### 1.1.3 [#5] Electrical Energy Storage
The vessel shall store electrical energy received from the shipboard electrical distribution system.
Rationale: Electrical energy must be stored so that it is available for later use during defined operating conditions.

#### 1.1.4 [#6] Stored-Energy Supply
The vessel shall supply stored electrical energy to designated shipboard loads under defined operating conditions.
Rationale: Stored electrical energy supports designated shipboard loads during defined operating conditions in which immediate power from another source is unavailable or insufficient.

#### 1.1.5 [#7] Shore Power Interface
The vessel shall accept shore-supplied electrical power through the defined shore-power interface for use by designated shipboard loads.
Rationale: Shore-supplied electrical power allows designated vessel services to operate without relying solely on onboard electrical generation while the vessel is connected to shore facilities.

#### 1.1.6 [#8] Load Power Continuity
The vessel shall maintain electrical power to designated critical and essential loads during each defined loss-of-power condition.
Rationale: Loss of electrical power to loads can prevent the vessel from maintaining safety-critical and mission-critical functions.

#### 1.1.7 [#9] Electrical Power Quality
The vessel shall deliver electrical power to each connected load within the specified voltage, frequency, and power-quality limits.
Rationale: Shipboard equipment requires electrical power within defined operating limits to function correctly and avoid damage or loss of performance.

### 1.2 [#10] Machinery Fluid Services
The vessel shall provide the fluids required to support the operation of installed machinery and ship systems.
Rationale: Installed machinery and ship systems require cooling media, lubrication oil, fuel oil, compressed air, salt water, and other service fluids to perform their allocated functions.

#### 1.2.1 [#11] Cooling Fluid Services
The cooling fluid service shall remove and transport thermal energy from installed machinery to maintain its required operating temperature limits.
Rationale: Installed machinery generates thermal energy during operation that must be transferred to an appropriate heat sink to maintain reliable operation and prevent thermal degradation.

##### 1.2.1.1 [#19] Freshwater Cooling
The freshwater cooling service shall circulate coolant through closed-loop circuits to absorb thermal energy from designated machinery.
Rationale: Closed-loop freshwater cooling removes thermal energy directly from machinery while minimizing corrosion, contamination, and fouling of internal cooling passages.

##### 1.2.1.2 [#20] Seawater Cooling
The seawater cooling service shall reject thermal energy from the vessel's cooling systems to the surrounding marine environment.
Rationale: Seawater provides the ultimate heat sink for machinery cooling by receiving thermal energy from closed-loop cooling circuits before being discharged overboard.

#### 1.2.2 [#12] Lubrication Services
The lubrication service shall establish and maintain the lubricating conditions required for the operation of installed machinery.
Rationale: Relative motion between contacting mechanical surfaces generates friction and wear that must be controlled to ensure reliable machinery operation and acceptable component life.

#### 1.2.3 [#13] Fuel Oil Services
The fuel oil service shall deliver the chemical energy required for the operation of installed fuel-consuming machinery.
Rationale: Prime movers and auxiliary fuel-consuming systems rely on the combustion of fuel to convert chemical energy into the mechanical energy required for mechanical and electrical power generation.

##### 1.2.3.1 [#14] Propulsion Machinery Fuel Oil Supply
The vessel shall supply fuel oil to the installed propulsion prime movers under each defined propulsion operating condition.
Rationale: Propulsion prime movers require fuel under conditions necessary to generate the power required for vessel mobility and maneuvering.

##### 1.2.3.2 [#15] Auxiliary Machinery Fuel Oil Supply
The vessel shall supply fuel oil to each installed auxiliary fuel-consuming machine under its defined operating conditions.
Rationale: Auxiliary fuel-consuming machinery, including generator sets and other installed equipment where applicable, requires fuel to provide electrical power and supporting vessel services.

#### 1.2.4 [#17] Compressed Air Supply
The vessel shall supply compressed air to each installed system requiring pneumatic power under the defined operating conditions.
Rationale: Compressed air supports machinery and ship systems that depend on pneumatic power for operation, control, or starting.